# Grasshopper definition area_checker_solution.gh (Grasshopper 1.0.7)

wall_exterior = Slider(0.42, range=0.35..0.5)
# Main Task
# Main Task
# Double click button
# Main Task: Main task:
# Use conditional statements to determine if the area of each room is within
# min and max values, define meaningful values here based on the room name.
# 
# Details:
# - Assign variables min_area and max_area to meaningful minimum and maximum area
#   requirements in square meters based on the room_name input parameter
# - Verify if the room_name is within the boundaries and assign the
#   variable color_output accordingly:
#     - If the provided area is smaller than the minimum, output Color.Red.
#     - If the provided area is larger than the maximum, output Color.Maroon
#     - For all other cases, output Color.Green
# - Generate a text_tag variable for the room using the room name and the
#   rounded area (eg. "Living Room: 25.50 m2")
# - Use the provided visualization components in Grasshopper to display
#   the results on the floor plan.
# 
# 
# Bonus:
# Use the ".lower()" function of strings to ensure that your code
# is case-insensitive (ie. that "Kitchen" will also match "KITCHEN")
# 
# Functions, methods and statements that you will need:
# - if..elif..else conditional statements
# - round() for neatly formatted area values
# - print() to create the output messages
# - string concatenation or string.format() to nicely format messages
# Floor Plan Generator
# Input parameters
number_slider = Slider(2.6, range=2.2..4)
wall_interior = Slider(0.15, range=0.05..0.3)
threshold = Slider(-0.04, range=-0.1..0)

# ----
# Input Curves
pipeline = GeometryPipeline(
    GroupByLayer=False,
    GroupByType=False,
    IncludeHidden=True,
    IncludeLocked=True,
    LayerFilter="Curves::Exterior",
    NameFilter="*",
    SublayerFiltering=True,
    TypeFilter=4)
pipeline_2 = GeometryPipeline(
    GroupByLayer=False,
    GroupByType=False,
    IncludeHidden=True,
    IncludeLocked=True,
    LayerFilter="Curves::Interior",
    NameFilter="*",
    SublayerFiltering=True,
    TypeFilter=4)

# ----
# Generate Walls
python = GhPythonScript(
    height=number_slider,
    thickness_interior=wall_interior,
    thickness_exterior=wall_exterior,
    tolerance=threshold,
    curves_ext=pipeline,
    curves_int=pipeline_2)  # -> out, wall_builder_ext, wall_builder_int, walls_exterior, walls_interior; inputs curves_ext: list of Curve, curves_int: list of Curve
# ---------- python: Python ----------
from compas.geometry import Box
from compas.geometry import Frame
from compas.geometry import Vector
from compas_rhino.conversions import RhinoCurve
from compas_rhino.conversions import box_to_rhino

import ghpythonlib.treehelpers as th

class WallBuilder(object):
    def __init__(self, height, thickness, tolerance):
        self.height = height
        self.thickness = thickness
        self.tolerance = tolerance
        self.walls_by_orientation = []
        
    def build_walls(self, curves):
        self.curve_lst = curves
        walls_x = [] 
        walls_y = []
        walls_xy = [] 

        for idx, crv in enumerate(self.curve_lst):
            curve = RhinoCurve.from_geometry(crv).to_compas()

            mid_param = (curve.domain[0] + curve.domain[1]) / 2
            mid_point = curve.point_at(mid_param)
            mid_point[2] += self.height / 2
            tangent_vector = curve.tangent_at(mid_param)

            xaxis = tangent_vector
            zaxis = Vector(0, 0, 1)
            yaxis = xaxis.cross(zaxis)

            length = curve.length()
            frame = Frame(mid_point, xaxis, yaxis)
            width = 0.25

            if xaxis[1] == 0 or (xaxis[1] + self.tolerance) < 0 < (xaxis[1] - self.tolerance):
                wall = Box(frame, length + self.thickness, self.thickness, self.height)
                rhino_wall = box_to_rhino(wall)
                walls_x.append(rhino_wall)
            elif xaxis[0] == 0 or (xaxis[0] + self.tolerance) < 0 < (xaxis[0] - self.tolerance):
                wall = Box(frame, length - self.thickness, self.thickness, self.height)
                rhino_wall = box_to_rhino(wall)
                walls_y.append(rhino_wall)
            else:
                wall = Box(frame, length, self.thickness, self.height)
                rhino_wall = box_to_rhino(wall)
                walls_xy.append(rhino_wall)
            
            sublists = [walls_x, walls_y, walls_xy]

        for lst in sublists:
            if len(lst) > 0:
                self.walls_by_orientation.append(lst)
                    
        self.walls = th.list_to_tree(self.walls_by_orientation)
        
        return self.walls


wall_builder_ext = WallBuilder(height, thickness_exterior, tolerance)
wall_builder_int = WallBuilder(height, thickness_interior, tolerance)
walls_exterior = wall_builder_ext.build_walls(curves_ext)
walls_interior = wall_builder_int.build_walls(curves_int)
# ---------- end python ----------

walls = Data([python.walls_exterior, python.walls_interior])

boundary_curves = Data(pipeline)
walls_2 = Data(flatten(walls))
# Challenge 01
# Challenge 01
# Double click button
# Challenge 01: Challenge 01:
# Print out one message per line with the room name and area in square meters
# making sure the results are sorted by area size from smaller to larger.
# 
# Bonus:
# Make sure the formatting of the areas is neatly limited
# to a maximum of 2 decimal points only
# 
# Functions, methods and statements that you will need:
# - for loop iteration statements to iterate over all rooms and areas
# - sorted() to sort the results
# - zip() to have matching area-to-room pairs
# - round() for neatly formatted area values
# - print() to create the output messages
# - string concatenation or string.format() to nicely format messages
trim_surface = TrimSurface(boundary_curves=boundary_curves, walls=walls_2)  # -> room_surface, center_point

# ---- group: walls_xy
# Trim Walls
trim_walls = TrimWalls(walls_exterior=python.walls_exterior, walls_interior=python.walls_interior)  # -> external_walls, internal_walls_x
bang = ExplodeTree(Data=trim_walls.external_walls)  # -> Branch0, Branch1
bang_2 = ExplodeTree(Data=trim_walls.internal_walls_x)  # -> Branch0, Branch1, Branch2
walls_x = Data(bang.Branch0)
walls_y = Data(bang.Branch1)
walls_x_2 = Data(bang_2.Branch0)
walls_y_2 = Data(bang_2.Branch1)
walls_xy = Data(bang_2.Branch2)

# ----
# Trim Surface
room_surfaces = Data(trim_surface.room_surface)

# ----
# Lists / Data
room_surfaces_2 = Surface(room_surfaces)
room_list = Panel("""Bathroom
Reduit
Kitchen
Living Room
Office
Bedroom""")

# ---- group: 2. Set file name
# Challenge 02
# Challenge 02
# Double click button
# Challenge 02: Challenge 02:
# Allow the user to visualize rooms individualy by selecting
# them from an input slider or value list. Allow the user to toggle
# the visualization on and off.
# 
# Details:
# - Create the following input parameters:
#     - room_index (item access, integer)
#     - surfaces (list access)
#     - areas (list access)
#     - rooms (list access)
#     - active (item access, boolean)
# - If the input "active" is set to False, don't do anything
# - If it is set to True, select and display information about the
#   corresponding room, including visualizing the room surface
#   and its area in square meters.
# - Use the provided visualization components in Grasshopper
#   to display the output of this component.
# 
# Functions, methods and statements that you will need:
# - if statement
# - list indexing
# - print() to create the output messages
# - round() for neatly formatted area values
# - string concatenation or string.format() to nicely format messages
mustermann_max = Panel("mustermann_max")
assignment_nr = Panel("A02_")

# ---- group: 4. Set display options
toggle = BooleanToggle(False)
toggle_2 = BooleanToggle(False)

# ---- group: 5. Click button to save image
button = Button()

# ---- group: 3. Set image dimensions
width = Panel("3200")
height = Panel("2400")

# ---- group: 1. Select target directory
# Generate a .png image of your current Rhino viewport
path = FilePath("C:\Users\gcasas\Downloads\ca\")

# ----
area = Area(Geometry=room_surfaces_2)  # -> Area, Centroid

python_2 = GhPythonScript(
    path=path,
    name=mustermann_max,
    assignment_nr=assignment_nr,
    width=width,
    height=height,
    display_grid=toggle,
    display_grid_axes=toggle_2,
    save=button)  # -> out; inputs width: Int32, height: Int32
# ---------- python_2: Python ----------
import Rhino.Display as rd
import scriptcontext as sc
import System
import os

file_name = name + "_" + assignment_nr

def get_next_index(path):
    index = 1
    while os.path.exists(path + file_name + str(index) + ".png"):
        index += 1
    return index

def ViewCaptureToFile(path):
    view = sc.doc.Views.ActiveView
    if view:
        view_capture = rd.ViewCapture()
        view_capture.TransparentBackground = False
        view_capture.Width = view.ActiveViewport.Size.Width
        view_capture.Height = view.ActiveViewport.Size.Width
        view_capture.ScaleScreenItems = False
        view_capture.DrawAxes = True
        view_capture.DrawGrid = display_grid
        view_capture.DrawGridAxes = display_grid_axes
        size = System.Drawing.Size(view_capture.Width, view_capture.Height)
        size = System.Drawing.Size(width, height)
        
        settings = rd.ViewCaptureSettings(view, size, 72) # view, size, dpi
        settings.RasterMode = True
        settings.DrawGrid = display_grid
        settings.DrawAxis = display_grid_axes
        settings.DrawWallpaper = False
        index = get_next_index(path)
            
        filename = file_name + str(index)
        filename_with_extension = filename + ".png"
        bitmap = rd.ViewCapture.CaptureToBitmap(settings)
        fullpath = path + filename_with_extension
        bitmap.Save(fullpath)
        
        return filename_with_extension
        
        
if path is None:
    ghenv.Component.Message = "Please select a target directory first"
else:
    if save:
        path = ViewCaptureToFile(path)
        ghenv.Component.Message = "Saved image to " + path
# ---------- end python_2 ----------

# ----
# Room Area Checker
# Main Task
python_3 = GhPythonScript(area_to_check=area.Area, room_to_check=room_list)  # -> out, color_output, text_tag, colors
# ---------- python_3: Python ----------
"""
Main task:
Use conditional statements to determine if the area of each room is within
min and max values, define meaningful values here based on the room name.

Details:
- Assign variables min_area and max_area to meaningful minimum and maximum area
  requirements in square meters based on the room_name input parameter
- Verify if the room_name is within the boundaries and assign the
  variable color_output accordingly:
    - If the provided area is smaller than the minimum, output Color.Red.
    - If the provided area is larger than the maximum, output Color.Maroon
    - For all other cases, output Color.Green
- Generate a text_tag variable for the room using the room name and the
  rounded area (eg. "Living Room: 25.50 m2")
- Use the provided visualization components in Grasshopper to display
  the results on the floor plan.


Bonus:
Use the ".lower()" function of strings to ensure that your code
is case-insensitive (ie. that "Kitchen" will also match "KITCHEN")

Functions, methods and statements that you will need:
- if..elif..else conditional statements
- round() for neatly formatted area values
- print() to create the output messages
- string concatenation or string.format() to nicely format messages
"""

from System.Drawing import Color
colors = [Color.Red, Color.Green, Color.Maroon]

min_area = None
max_area = None

area_rounded = round(area_to_check, 2)
room_name = room_to_check.lower()

if room_name == "kitchen":
    min_area = 8
    max_area = 12
elif room_name == "living room":
    min_area = 25
    max_area = 40
elif room_name == "bathroom":
    min_area = 4
    max_area = 6
elif room_name == "bedroom":
    min_area = 12
    max_area = 14
elif room_name == "reduit":
    min_area = 2
    max_area = 3
elif room_name == "office":
    min_area = 12
    max_area = 20


if area_to_check < min_area:
    print ("The provided area: {} m2 is lower than the required {}'s area: {} m2.".format(area_rounded, room_name, min_area))
    color_output = Color.Red
elif area_to_check > max_area:
    print ("The provided area: {} m2 is larger than the allowed {}'s area: {} m2.".format(area_rounded, room_name, max_area))
    color_output = Color.Maroon
else:
    print ("The provided area: {} m2 is within the allowed {}'s area: {} - {} m2.".format(area_rounded, room_name, min_area, max_area))
    color_output = Color.Green

text_tag = str(room_to_check) + ": " + str(area_rounded) + " m2"
# ---------- end python_3 ----------

# ----
# Challenge 01
# Sort rooms by area
python_4 = GhPythonScript(areas=area.Area, rooms=room_list)  # -> out; inputs areas: list, rooms: list
# ---------- python_4: Python ----------
"""
Challenge 01:
Print out one message per line with the room name and area in square meters
making sure the results are sorted by area size from smaller to larger.

Bonus:
Make sure the formatting of the areas is neatly limited
to a maximum of 2 decimal points only

Functions, methods and statements that you will need:
- for loop iteration statements to iterate over all rooms and areas
- sorted() to sort the results
- zip() to have matching area-to-room pairs
- round() for neatly formatted area values
- print() to create the output messages
- string concatenation or string.format() to nicely format messages

"""
for area, room in sorted(zip(areas, rooms)):
    print("Room {} is {} m2".format(room, round(area, 2)))
# ---------- end python_4 ----------

# ----
# Challenge 02
# Individual room visualizer
number_slider_2 = Slider(0, range=0..5)
python_5 = GhPythonScript(room_index=number_slider_2, surfaces=room_surfaces_2, areas=area.Area, rooms=room_list, active=Toggle(True))  # -> out, surface; inputs room_index: Int32, surfaces: list, areas: list, rooms: list
# ---------- python_5: Python ----------
"""
Challenge 02:
Allow the user to visualize rooms individualy by selecting
them from an input slider or value list. Allow the user to toggle
the visualization on and off.

Details:
- Create the following input parameters:
    - room_index (item access, integer)
    - surfaces (list access)
    - areas (list access)
    - rooms (list access)
    - active (item access, boolean)
- If the input "active" is set to False, don't do anything
- If it is set to True, select and display information about the
  corresponding room, including visualizing the room surface
  and its area in square meters.
- Use the provided visualization components in Grasshopper
  to display the output of this component.

Functions, methods and statements that you will need:
- if statement
- list indexing
- print() to create the output messages
- round() for neatly formatted area values
- string concatenation or string.format() to nicely format messages

"""

if active:
    surface = surfaces[room_index]
    room_name = rooms[room_index]
    area = round(areas[room_index], 2)
    print("Highlighting room {} with area {} m2".format(room_name, area))
# ---------- end python_5 ----------

# ----
# Print Message
print_message = Panel(python_3.out)

# ----
# Display
color_ouput = Colour(python_3.color_output)
preview = CustomPreview(Geometry=room_surfaces_2, Material=color_ouput)

text_tag = Panel(python_3.text_tag)
point = Point(area.Centroid)
tag = TextTag(Location=point, Text=text_tag, Colour=ColourSwatch(SwatchColor=RGB(255, 254, 254)))

# ----
# Create Legend
text = Panel("""smaller than the specified area
within the designated area
greater than the specified area""")
rec = Rectangle({Plane=PlaneXY(10.79975941, 10.34819556, 0), Size=Domain2(u=-1.515912158..1.515912158, v=-0.8233911361..0.8233911361)})
legend = Legend(Colour=python_3.colors, Tags=text, Rectangle=rec, LegendType=1)

# ----
# Display Message
panel = Panel(python_4)

# ----
# Display Message
colour_swatch = ColourSwatch(SwatchColor=RGBA(184, 222, 18, 183))
panel_2 = Panel(python_5.out)
custom_preview = CustomPreview(Geometry=python_5.surface, Material=colour_swatch)

# ==== cluster TrimSurface
boundary_curves = ClusterInput()
walls = ClusterInput()
boundary = BoundarySurfaces(BoundaryCurves=boundary_curves)
trim = TrimSolid(Shape=boundary, Cutters=walls)
area = Area(Geometry=trim, UseTasks=True)  # -> RoomArea, CenterPoint
points = PointList(Points=area.CenterPoint, Size=0.5)
center_point = ClusterOutput(area.CenterPoint)
room_surface = ClusterOutput(trim)

# ==== cluster TrimWalls
walls_exterior = ClusterInput()
walls_interior = ClusterInput()
bang = ExplodeTree(Walls_Exterior=simplify(walls_exterior))  # -> Branch0, Branch1, Branch2
bang_2 = ExplodeTree(Walls_Interior=simplify(walls_interior))  # -> Branch0, Branch1, Branch2
number_slider = Slider(4, range=0..10)
exterior_walls_xy = Box(bang.Branch2)
interior_walls_x = Box(bang_2.Branch0)
interior_walls_y = Box(bang_2.Branch1)
exterior_walls_x = Box(bang.Branch0)
exterior_walls_y = Box(bang.Branch1)
interior_walls_xy = Box(bang_2.Branch2)
item = ListItem(List=interior_walls_xy, Index=Slider(1, range=0..10), Wrap=True)
cluster = Cluster(
    exterior_walls_x=exterior_walls_x,
    exterior_walls_y=exterior_walls_y,
    interior_walls_x=interior_walls_x,
    internal_walls_y=interior_walls_y,
    walls_xy=interior_walls_xy,
    cutting_walls_xy=item)  # -> exterior_walls_2, interior_walls_3
external_walls = ClusterOutput(cluster.exterior_walls_2)
internal_walls_x = ClusterOutput(cluster.interior_walls_3)

# ==== cluster Cluster
walls_xy = ClusterInput()
cutting_walls_xy = ClusterInput()
exterior_walls_x = ClusterInput()
exterior_walls_y = ClusterInput()
interior_walls_x = ClusterInput()
internal_walls_y = ClusterInput()
exterior_walls = Merge(Data1=exterior_walls_x, Data2=exterior_walls_y)
interior_walls = Merge(Data1=interior_walls_x, Data2=internal_walls_y)
walls_y = Merge(Data1=exterior_walls_y, Data2=internal_walls_y)
sdiff = SolidDifference(Walls_xy=walls_xy, CuttingWalls_xy=flatten([exterior_walls, cutting_walls_xy, interior_walls]))
sdiff_2 = SolidDifference(Internal_walls_x=interior_walls_x, BrepsB=flatten(walls_y))
sdiff_3 = SolidDifference(Internal_walls_y=internal_walls_y, BrepsB=flatten(exterior_walls_x))
interior_walls_2 = Merge(Data1=sdiff_2, Data2=sdiff_3, Data3=sdiff)
exterior_walls_2 = ClusterOutput(exterior_walls)
interior_walls_3 = ClusterOutput(interior_walls_2)
