# Grasshopper definition filtered-grid_solution.gh (Grasshopper 1.0.7)

# ----
# Main Task
# Main Task
# Double click button
# Main Task: #### Main task
# 
# Create a new kind of filter by implementing a new class. Use the examples above
# as inspiration. Your new filter class should have one method `is_included`
# that takes 3 parameters as input: `x`, `y`, `z` and returns `True` or `False` as output
# indicating whether the specific point should be included or not in the final result.
# 
# The filter should be mathematically-defined, implementing **the paraboloid function**.
# 
# #### Details
# 
# - Create a class, eg. `ParaboloidFilter`.
# - Add a method `is_included` to it. This method should return `True` if the
#   criteria of the current `x`, `y`, `z` input parameters match, otherwise `False.`
# - Right below the class, create an instance of it and assign it to the output of this
#   component.
# - Plug the component to the `Stream filter` one in order to test it.
# 
# #### Bonus
# 
# - Add a `__str__` magic method that returns a string describing the filter in a nice way.
# 
# #### Functions, classes, methods and statements that you will need
# 
# - Class definition
# - A class constructor (`__init__`).
# - Attributes of a class. For a paraboliod filter, you might need to
#   store the shift in X and Y and a coefficient as attributes.
# Filtering grids with object-oriented programming
# Examples of filters
modulo_filter = GhPythonScript()  # -> mfilter
# ---------- modulo_filter: Python ----------
# Sample filter
class ModuleBasedFilter(object):
    def is_included(self, x, y, z):
        if (x + y) % 2 == 0:
            return True

        return False

mfilter = ModuleBasedFilter()
# ---------- end modulo_filter ----------
random_filter = GhPythonScript()  # -> rfilter
# ---------- random_filter: Python ----------
# Sample filter
from random import choice

class RandomFilter(object):
    def is_included(self, x, y, z):
        return choice([True, False])

rfilter = RandomFilter()
# ---------- end random_filter ----------
linear_filter = GhPythonScript()  # -> lfilter
# ---------- linear_filter: Python ----------
# Sample filter
class LinearFilter(object):
    def __init__(self, coefficient=1, vertical_shift_x=0, vertical_shift_y=0, horizontal_shift_x=0, horizontal_shift_y=0):
        super(LinearFilter, self).__init__()
        self.coefficient = coefficient
        self.vertical_shift_x = vertical_shift_x
        self.vertical_shift_y = vertical_shift_y
        self.horizontal_shift_x = horizontal_shift_x
        self.horizontal_shift_y = horizontal_shift_y

    def is_included(self, x, y, z):
        z_range_x = (self.coefficient * x + self.vertical_shift_x) + self.horizontal_shift_x
        z_range_y = (self.coefficient * y + self.vertical_shift_y) + self.horizontal_shift_y
        return not z_range_x < z > z_range_y

lfilter = LinearFilter(coefficient= 3, vertical_shift_x= -3, vertical_shift_y=-3, horizontal_shift_x=0, horizontal_shift_y=0)
# ---------- end linear_filter ----------

# ---- group: Main task
# Main Task
filter = GhPythonScript()  # -> pfilter
# ---------- filter: Python ----------
"""
#### Main task

Create a new kind of filter by implementing a new class. Use the examples above 
as inspiration. Your new filter class should have one method `is_included`
that takes 3 parameters as input: `x`, `y`, `z` and returns `True` or `False` as output
indicating whether the specific point should be included or not in the final result.

The filter should be mathematically-defined, implementing **the paraboloid function**.

#### Details

- Create a class, eg. `ParaboloidFilter`.
- Add a method `is_included` to it. This method should return `True` if the
  criteria of the current `x`, `y`, `z` input parameters match, otherwise `False.`
- Right below the class, create an instance of it and assign it to the output of this
  component.
- Plug the component to the `Stream filter` one in order to test it.

#### Bonus

- Add a `__str__` magic method that returns a string describing the filter in a nice way.

#### Functions, classes, methods and statements that you will need

- Class definition
- A class constructor (`__init__`).
- Attributes of a class. For a paraboliod filter, you might need to 
  store the shift in X and Y and a coefficient as attributes.
"""

class ParaboloidFilter(object):
    def __init__(self, coefficient=1, shift_x=0, shift_y=0):
        super(ParaboloidFilter, self).__init__()
        self.coefficient = coefficient
        self.shift_x = shift_x
        self.shift_y = shift_y

    def is_included(self, x, y, z):
        return (x - self.shift_x) ** 2 + (y - self.shift_y) ** 2 > self.coefficient * z

pfilter = ParaboloidFilter(coefficient=3, shift_x=3, shift_y=3)
# ---------- end filter ----------

# ----
# A minimal example of a geometry-based filter
point = Point(Point(36.33476007, 23.12742243, 63.20983759))
sphere = Sphere(Base=point, Radius=Slider(22, range=1..200))
filter_2 = GhPythonScript(brep=sphere)  # -> bfilter; inputs brep: Brep
# ---------- filter_2: Python ----------
import Rhino
import Rhino.Geometry as rg
import rhinoscriptsyntax as rs

class BrepFilter(object):
    def __init__(self, dx=5, dy= 5, dz=3.5):
        super(BrepFilter, self).__init__()
        self.dx = dx
        self.dy = dy
        self.dz = dz

    def is_included(self, x, y, z):
        return not brep.IsPointInside(rg.Point3d(x * self.dx, y * self.dy, z * self.dz), Rhino.RhinoMath.SqrtEpsilon, True)

bfilter = BrepFilter()
# ---------- end filter_2 ----------

# ----
# Challenge 02
merge = Merge(Data1=linear_filter, Data2=filter)

# ---- group: Challenge 02
filter_3 = GhPythonScript(sub_filters=merge)  # -> mfilter; inputs sub_filters: list
# ---------- filter_3: Python ----------
"""
## Challenge 02

Allow to create a filter that is the combination of two or more filters (ie. sub-filters).
The new filter class could combine them using an **OR GATE** or an **AND GATE**,
ie. the `is_included` method returns `True` as soon as any of its sub-filters returns `True`,
or alternatively, it could return `True` only if all its sub-filters returns `True`.

The logical **OR GATE** and **AND GATE** are concepts of Grasshopper, and they simply mean
"True if any condition is true" and "True if all conditions are true" respectively. 

- Example of OR GATE in Python: `room == "bedroom" or room == "kitchen"`
- Example of AND GATE in Python: `area > 10 and area < 40`

#### Details

- Create a class, eg `ORGateMergeFilter`.
- Add a constructor (`__init__`) taking `subfilters` as parameter.
- Add the method `is_included` and implement **OR GATE** logic to return
  `True` as soon as any of the subfilters returns `True`.

#### Functions, methods and statements that you will need

- Class definition.
- `if` statement.
- Class attributes containing complex types. 
"""

class MergeFilter(object):
    def __init__(self, sub_filters):
        super(MergeFilter, self).__init__()
        self.sub_filters = sub_filters

    def is_included(self, x, y, z):
        for f in self.sub_filters:
            if not f.is_included(x, y, z):
                return False

        return True

mfilter = MergeFilter(sub_filters)
# ---------- end filter_3 ----------

# ----
# Challenge 01
# Challenge 01
# Double click button
# Challenge 01: ## Challenge 01
# 
# Visualize the point grid using boxes instead of points. For each points in the
# filtered grid, create a `Box` instance. Each box should be placed in space where the point is.
# Use the `xsize`, `ysize`, `zsize` sliders to determine a size that matches the spacing of the grid.
# Connect to the COMPAS component to display the geometry on the Rhino viewpoint.
# 
# #### Details
# 
# - Connect the `xsize`, `ysize`, `zsize` sliders as inputs
# - Iterate over all points
# - Create a box using `from_corner_corner_height`
# - Append to a list
# - Assign the list of boxes to an output parameter
# 
# #### Functions, methods and statements that you will need
# 
# - `Box` class from `compas.geometry.Box`
# - `Box.from_corner_corner_height` method to create instances.
# - `Point` class to create new points for the second corner of the box.
# - `.append()` method of a list to create the list of all boxes.
value_list = ValueList({"Modulo filter": 0, "Random filter": 1, "Linear filter": 2, "Main task filter": 3, "Challenge 02 filter": 4}, selected="Main task filter")
stream_filter = StreamFilter(Gate=value_list, Stream0=modulo_filter, Stream1=random_filter, Stream2=linear_filter, Stream3=filter, Stream4=filter_3)

# ---- group: Grid size
number_slider = Slider(9, range=0..20)
number_slider_2 = Slider(9, range=0..20)
number_slider_3 = Slider(18, range=0..20)

# ----
s_2 = Data(stream_filter)

# ---- group: Cell sizes
number_slider_4 = Slider(5, range=0..20)
number_slider_5 = Slider(5, range=0..20)
number_slider_6 = Slider(3.5, range=0..20)

# ----
grid = GhPythonScript(
    nx=number_slider,
    ny=number_slider_2,
    nz=number_slider_3,
    selected_filter=s_2,
    xsize=number_slider_4,
    ysize=number_slider_5,
    zsize=number_slider_6)  # -> out, points; inputs nx: Int32, ny: Int32, nz: Int32
# ---------- grid: Python ----------
from compas.geometry import Point
from itertools import product

points = []
for x, y, z in product(range(nx), range(ny), range(nz)):
    if not selected_filter or selected_filter.is_included(x, y, z):
        points.append(Point(x * xsize, y * ysize, z * zsize))
# ---------- end grid ----------
draw = Draw(cg=grid.points)  # -> rg; inputs cg: list
#   port cg: The COMPAS geometry or datastructure to be drawn.
#   port rg: The Rhino geometry object.
# ---------- draw: Python ----------
"""
Draws COMPAS geometry in Grasshopper.
"""
from ghpythonlib.componentbase import executingcomponent as component

from compas.artists import Artist


class CompasToRhinoGeometry(component):
    def RunScript(self, cg):
        if not cg:
            return None
        artist = Artist(cg[0])
        rg = []
        for i in cg:
            artist.primitive = i
            rg.append(artist.draw())
        return rg
# ---------- end draw ----------

# ---- group: 2. Set file name
# Challenge 02
# Challenge 02
# Double click button
# Challenge 02: ## Challenge 02
# 
# Allow to create a filter that is the combination of two or more filters (ie. sub-filters).
# The new filter class could combine them using an **OR GATE** or an **AND GATE**,
# ie. the `is_included` method returns `True` as soon as any of its sub-filters returns `True`,
# or alternatively, it could return `True` only if all its sub-filters returns `True`.
# 
# The logical **OR GATE** and **AND GATE** are concepts of Grasshopper, and they simply mean
# "True if any condition is true" and "True if all conditions are true" respectively.
# 
# - Example of OR GATE in Python: `room == "bedroom" or room == "kitchen"`
# - Example of AND GATE in Python: `area > 10 and area < 40`
# 
# #### Details
# 
# - Create a class, eg `ORGateMergeFilter`.
# - Add a constructor (`__init__`) taking `subfilters` as parameter.
# - Add the method `is_included` and implement **OR GATE** logic to return
#   `True` as soon as any of the subfilters returns `True`.
# 
# #### Functions, methods and statements that you will need
# 
# - Class definition.
# - `if` statement.
# - Class attributes containing complex types.
mustermann_max = Panel("mustermann_max")
assignment_nr = Panel("A02_")

# ---- group: 4. Set display options
toggle = BooleanToggle(False)
toggle_2 = BooleanToggle(False)

# ---- group: 5. Click button to save image
button = Button()

# ---- group: 3. Set image dimensions
width = Panel("3200")
height = Panel("2400")

# ---- group: 1. Select target directory
# Generate a .png image of your current Rhino viewport
path = FilePath()

# ---- group: Challenge 01
boxes = GhPythonScript(points=grid.points, xsize=number_slider_4, ysize=number_slider_5, zsize=number_slider_6)  # -> boxes; inputs points: list
# ---------- boxes: Python ----------
"""
## Challenge 01

Visualize the point grid using boxes instead of points. For each points in the
filtered grid, create a `Box` instance. Each box should be placed in space where the point is.
Use the `xsize`, `ysize`, `zsize` sliders to determine a size that matches the spacing of the grid.
Connect to the COMPAS component to display the geometry on the Rhino viewpoint.

#### Details

- Connect the `xsize`, `ysize`, `zsize` sliders as inputs
- Iterate over all points
- Create a box using `from_corner_corner_height`
- Append to a list
- Assign the list of boxes to an output parameter

#### Functions, methods and statements that you will need

- `Box` class from `compas.geometry.Box`
- `Box.from_corner_corner_height` method to create instances.
- `Point` class to create new points for the second corner of the box.
- `.append()` method of a list to create the list of all boxes.

"""
from compas.geometry import Box
from compas.geometry import Point

# Challenge 01
boxes = []
for point in points:
    box = Box.from_corner_corner_height(point, Point(point.x + xsize, point.y + ysize, point.z), zsize)
    boxes.append(box)

points = boxes
# ---------- end boxes ----------
# Challenge 01
draw_2 = Draw(cg=boxes)  # -> rg; inputs cg: list
#   port cg: The COMPAS geometry or datastructure to be drawn.
#   port rg: The Rhino geometry object.
# ---------- draw_2: Python ----------
"""
Draws COMPAS geometry in Grasshopper.
"""
from ghpythonlib.componentbase import executingcomponent as component

from compas.artists import Artist


class CompasToRhinoGeometry(component):
    def RunScript(self, cg):
        if not cg:
            return None

        artist = Artist(cg[0])
        
        rg = []
        for i in cg:
            artist.shape = i
            rg.append(artist.draw())
        return rg
# ---------- end draw_2 ----------

# ----
python = GhPythonScript(
    path=path,
    name=mustermann_max,
    assignment_nr=assignment_nr,
    width=width,
    height=height,
    display_grid=toggle,
    display_grid_axes=toggle_2,
    save=button)  # -> out; inputs width: Int32, height: Int32
# ---------- python: Python ----------
import Rhino.Display as rd
import scriptcontext as sc
import System
import os

file_name = name + "_" + assignment_nr

def get_next_index(path):
    index = 1
    while os.path.exists(path + file_name + str(index) + ".png"):
        index += 1
    return index

def ViewCaptureToFile(path):
    view = sc.doc.Views.ActiveView
    if view:
        view_capture = rd.ViewCapture()
        view_capture.TransparentBackground = False
        view_capture.Width = view.ActiveViewport.Size.Width
        view_capture.Height = view.ActiveViewport.Size.Width
        view_capture.ScaleScreenItems = False
        view_capture.DrawAxes = True
        view_capture.DrawGrid = display_grid
        view_capture.DrawGridAxes = display_grid_axes
        size = System.Drawing.Size(view_capture.Width, view_capture.Height)
        size = System.Drawing.Size(width, height)
        
        settings = rd.ViewCaptureSettings(view, size, 72) # view, size, dpi
        settings.RasterMode = True
        settings.DrawGrid = display_grid
        settings.DrawAxis = display_grid_axes
        settings.DrawWallpaper = False
        index = get_next_index(path)
            
        filename = file_name + str(index)
        filename_with_extension = filename + ".png"
        bitmap = rd.ViewCapture.CaptureToBitmap(settings)
        fullpath = path + filename_with_extension
        bitmap.Save(fullpath)
        
        return filename_with_extension
        
        
if path is None:
    ghenv.Component.Message = "Please select a target directory first"
else:
    if save:
        path = ViewCaptureToFile(path)
        ghenv.Component.Message = "Saved image to " + path
# ---------- end python ----------
