# Grasshopper definition A03-building-grid-slabs_solution.gh (Grasshopper 1.0.7)

# ---- group: Grid size
number_slider = Slider(9, range=0..20)
number_slider_2 = Slider(18, range=0..20)
number_slider_3 = Slider(9, range=0..20)

# ---- group: Cell sizes
number_slider_4 = Slider(5, range=0..20)
number_slider_5 = Slider(4.5, range=0..20)
number_slider_6 = Slider(3.5, range=0..20)

# ---- group: Options
main_beam_width = Slider(0.35, range=0.1..0.9)
main_beam_height = Slider(0.4, range=0.1..0.9)
column_width_x = Slider(0.35, range=0.1..0.9)
column_depth_y = Slider(0.45, range=0.1..0.9)
slab_height = Slider(0.2, range=0.1..0.9)

# ---- group: 2. Set file name
# Challenge 02: ## Challenge 02
# 
# Goal: Calculate and print total volume of slabs, and the number (amount) of each element type (slabs, columns and main beams).
# 
# The methods to get the numbers of columns and mainbeams already exist on the BuildingGrid class so we can print them out directly.
# A new method number_of_slabs() needs to be added to the BuildingGrid class.
# 
# A new method to calculate the volume of each slab needs to be added to the Slab class.
# 
# #### Details
# 
# The algorithm that we need to implement, as well as hints to functions you might need,
# is in code comments, as a step-by-step guide.
mustermann_max = Panel("mustermann_max")
assignment_nr = Panel("A03_")

# ---- group: 4. Set display options
toggle = BooleanToggle(True)
toggle_2 = BooleanToggle(True)

# ---- group: 5. Click button to save image
button = Button()

# ---- group: 3. Set image dimensions
width = Panel("3200")
height = Panel("2400")

# ---- group: 1. Select target directory
path = FilePath()

# ----
python = GhPythonScript(
    path=path,
    name=mustermann_max,
    assignment_nr=assignment_nr,
    width=width,
    height=height,
    display_grid=toggle,
    display_grid_axes=toggle_2,
    save=button)  # -> out; inputs width: Int32, height: Int32
# ---------- python: Python ----------
import Rhino.Display as rd
import scriptcontext as sc
import System
import os

file_name = name + "_" + assignment_nr

def get_next_index(path):
    index = 1
    while os.path.exists(path + file_name + str(index) + ".png"):
        index += 1
    return index

def ViewCaptureToFile(path):
    view = sc.doc.Views.ActiveView
    if view:
        view_capture = rd.ViewCapture()
        view_capture.TransparentBackground = False
        view_capture.Width = view.ActiveViewport.Size.Width
        view_capture.Height = view.ActiveViewport.Size.Width
        view_capture.ScaleScreenItems = False
        view_capture.DrawAxes = True
        view_capture.DrawGrid = display_grid
        view_capture.DrawGridAxes = display_grid_axes
        size = System.Drawing.Size(view_capture.Width, view_capture.Height)
        size = System.Drawing.Size(width, height)
        
        settings = rd.ViewCaptureSettings(view, size, 72) # view, size, dpi
        settings.RasterMode = True
        settings.DrawGrid = display_grid
        settings.DrawAxis = display_grid_axes
        settings.DrawWallpaper = False
        index = get_next_index(path)
            
        filename = file_name + str(index)
        filename_with_extension = filename + ".png"
        bitmap = rd.ViewCapture.CaptureToBitmap(settings)
        fullpath = path + filename_with_extension
        bitmap.Save(fullpath)
        
        return filename_with_extension
        
        
if path is None:
    ghenv.Component.Message = "Please select a target directory first"
else:
    if save:
        path = ViewCaptureToFile(path)
        ghenv.Component.Message = "Saved image to " + path
# ---------- end python ----------

# ----
# Main Task: ## Main task
# 
# Goal: Create slabs for our building grid.
# 
# A slab is represented visually as a box (using compas.geometry.Box).
# The basic idea is to rely on the volmesh to know where to add each slab.
# We will create one slab per each face of our grid's volmesh if the face is
# aligned to the XY plane (ie. flat).
# 
# We will create a Slab class that will contain the attributes and methods of each slab.
# The Slab class needs two attributes: shape (a box), and function (a string).
# Function will only be used if you tackle challenge 01. Otherwise you can ignore it.
# 
# #### Details
# 
# The algorithm that we need to implement, as well as hints to functions you might need,
# is in code comments, as a step-by-step guide.
# Applying classes to create buildings
# Filters selection
modulo_filter = GhPythonScript()  # -> mfilter
# ---------- modulo_filter: Python ----------
# Sample filter
class ModuleBasedFilter(object):
    def is_included(self, x, y, z):
        if (x + y) % 2 == 0:
            return True

        return False

mfilter = ModuleBasedFilter()
# ---------- end modulo_filter ----------
random_filter = GhPythonScript()  # -> rfilter
# ---------- random_filter: Python ----------
# Sample filter
from random import choice

class RandomFilter(object):
    def is_included(self, x, y, z):
        return choice([True, False])

rfilter = RandomFilter()
# ---------- end random_filter ----------
linear_filter = GhPythonScript()  # -> lfilter
# ---------- linear_filter: Python ----------
# Sample filter
class LinearFilter(object):
    def __init__(self, coefficient=1, vertical_shift_x=0, vertical_shift_y=0, horizontal_shift_x=0, horizontal_shift_y=0):
        super(LinearFilter, self).__init__()
        self.coefficient = coefficient
        self.vertical_shift_x = vertical_shift_x
        self.vertical_shift_y = vertical_shift_y
        self.horizontal_shift_x = horizontal_shift_x
        self.horizontal_shift_y = horizontal_shift_y

    def is_included(self, x, y, z):
        z_range_x = (self.coefficient * x + self.vertical_shift_x) + self.horizontal_shift_x
        z_range_y = (self.coefficient * y + self.vertical_shift_y) + self.horizontal_shift_y
        return not z_range_x < z > z_range_y

lfilter = LinearFilter(coefficient= 3, vertical_shift_x= -3, vertical_shift_y=-3, horizontal_shift_x=0, horizontal_shift_y=0)
# ---------- end linear_filter ----------
paraboloid_filter = GhPythonScript()  # -> pfilter
# ---------- paraboloid_filter: Python ----------
# Solution of assignment 02: main task
class ParaboloidFilter(object):
    def __init__(self, coefficient=1, shift_x=0, shift_y=0):
        super(ParaboloidFilter, self).__init__()
        self.coefficient = coefficient
        self.shift_x = shift_x
        self.shift_y = shift_y

    def is_included(self, x, y, z):
        return (x - self.shift_x) ** 2 + (y - self.shift_y) ** 2 > self.coefficient * z

pfilter = ParaboloidFilter(coefficient=4, shift_x=0, shift_y=0)
# ---------- end paraboloid_filter ----------
value_list = ValueList({"Modulo filter": 0, "Random filter": 1, "Linear filter": 2, "Paraboloid filter": 3, "Merge filter": 4}, selected="Paraboloid filter")

merge = Merge(Data1=modulo_filter, Data2=paraboloid_filter)
merge_filter = GhPythonScript(sub_filters=merge)  # -> mfilter; inputs sub_filters: list
# ---------- merge_filter: Python ----------
# Solution of assignment 02: challenge 02
class MergeFilter(object):
    def __init__(self, sub_filters):
        self.sub_filters = sub_filters

    def is_included(self, x, y, z):
        for subfilter in self.sub_filters:
            if not subfilter.is_included(x, y, z):
                return False

        return True

mfilter = MergeFilter(sub_filters)
# ---------- end merge_filter ----------

stream_filter = StreamFilter(
    Gate=value_list,
    Stream0=modulo_filter,
    Stream1=random_filter,
    Stream2=linear_filter,
    Stream3=paraboloid_filter,
    Stream4=merge_filter)

# ----
# Challenge 01: ## Challenge 01
# 
# Goal: Assign the function of each slab
# 
# Each slab can be assigned one of three different functions: "roof", "floor_slab" or "bottom_slab".
# 
# #### Details
# 
# The algorithm that we need to implement, as well as hints to functions you might need,
# is in code comments, as a step-by-step guide.
# Create grid based on volumetric mesh
python_2 = GhPythonScript()  # -> from_meshgrid
# ---------- python_2: Python ----------
from itertools import product
from compas.datastructures import VolMesh
from compas.utilities import linspace

def from_meshgrid(selected_filter, dx, dy, dz, nx, ny, nz):
    vertices = [
        [x*nx, y*ny, z*nz]
        for z, x, y in product(
            linspace(0, dz, nz + 1),
            linspace(0, dx, nx + 1),
            linspace(0, dy, ny + 1),
        )
    ]

    cells = []
    for k, i, j in product(range(nz), range(nx), range(ny)):
        if not selected_filter.is_included(j, i, k):
            continue
        a = k * ((nx + 1) * (ny + 1)) + i * (ny + 1) + j
        b = k * ((nx + 1) * (ny + 1)) + (i + 1) * (ny + 1) + j
        c = k * ((nx + 1) * (ny + 1)) + (i + 1) * (ny + 1) + j + 1
        d = k * ((nx + 1) * (ny + 1)) + i * (ny + 1) + j + 1
        aa = (k + 1) * ((nx + 1) * (ny + 1)) + i * (ny + 1) + j
        bb = (k + 1) * ((nx + 1) * (ny + 1)) + (i + 1) * (ny + 1) + j
        cc = (k + 1) * ((nx + 1) * (ny + 1)) + (i + 1) * (ny + 1) + j + 1
        dd = (k + 1) * ((nx + 1) * (ny + 1)) + i * (ny + 1) + j + 1
        bottom = [d, c, b, a]
        front = [a, b, bb, aa]
        right = [b, c, cc, bb]
        left = [a, aa, dd, d]
        back = [c, d, dd, cc]
        top = [aa, bb, cc, dd]
        cells.append([bottom, front, left, back, right, top])

    return VolMesh.from_vertices_and_cells(vertices, cells)
# ---------- end python_2 ----------
filter = Data(stream_filter)
grid = GhPythonScript(
    from_meshgrid=python_2,
    nx=number_slider,
    ny=number_slider_3,
    nz=number_slider_2,
    selected_filter=filter,
    xsize=number_slider_4,
    ysize=number_slider_5,
    zsize=number_slider_6,
    main_beam_width=main_beam_width,
    main_beam_height=main_beam_height,
    column_width_x=column_width_x,
    column_depth_y=column_depth_y,
    slab_height=slab_height)  # -> grid; inputs nx: Int32, ny: Int32, nz: Int32
# ---------- grid: Python ----------
class BuildingGrid(object):
    """Represents a building structure built around a regular grid."""
    def __init__(self, xsize, ysize, zsize, nx, ny, nz, selected_filter, main_beam_width, main_beam_height, column_width_x, column_depth_y, slab_height):
        self.volmesh = from_meshgrid(selected_filter, xsize, ysize, zsize, nx, ny, nz)
        self.volmesh.cull_vertices()
        self.columns = []
        self.main_beams = []

        self.main_beam_width = main_beam_width
        self.main_beam_height = main_beam_height
        self.column_width_x = column_width_x
        self.column_depth_y = column_depth_y
        self.slab_height = slab_height

    # NOTE: We have moved the generate_columns and generate_main_beams methods
    # out from here and into the specific components that generate them

    def number_of_columns(self):
        return len(self.columns)

    def number_of_mainbeams(self):
        return len(self.main_beams)
        
    def number_of_slabs(self):
        return len(self.slabs)

grid = BuildingGrid(xsize, ysize, zsize, nx, ny, nz, selected_filter, main_beam_width, main_beam_height, column_width_x, column_depth_y, slab_height)
# ---------- end grid ----------

# ----
# Main Task
# and Challenge 01
slabs = GhPythonScript(grid=grid)  # -> slabs
# ---------- slabs: Python ----------
"""
## Main task

Goal: Create slabs for our building grid.

A slab is represented visually as a box (using compas.geometry.Box).
The basic idea is to rely on the volmesh to know where to add each slab.
We will create one slab per each face of our grid's volmesh if the face is 
aligned to the XY plane (ie. flat).

We will create a Slab class that will contain the attributes and methods of each slab.
The Slab class needs two attributes: shape (a box), and function (a string).
Function will only be used if you tackle challenge 01. Otherwise you can ignore it.

#### Details

The algorithm that we need to implement, as well as hints to functions you might need,
is in code comments, as a step-by-step guide.

---------------------------------------------------------------------------------------

## Challenge 01

Goal: Assign the function of each slab

Each slab can be assigned one of three different functions: "roof", "floor_slab" or "bottom_slab". 

#### Details

The algorithm that we need to implement, as well as hints to functions you might need,
is in code comments, as a step-by-step guide.

"""
from compas_rhino.conversions import box_to_rhino
from compas.geometry import Box
from compas.geometry import Point
from compas.geometry import Vector

# START OF MAIN TASK
# 1. Create a class Slab with two parameters in the its __init__: shape and function
class Slab(object):
    def __init__(self, shape, function=None):
        self.shape = shape
        self.function = function
    
    def calculate_volume(self):
        return self.shape.volume

# 2. Create a generate_slabs method that takes the grid as parameter
#    and appends slabs to its grid.slabs attribute
def generate_slabs(grid):
    # Reset slabs list to an empty list
    grid.slabs = []

    # Iterate: for each face in the volmesh (hint: faces() of volmesh)
    for hf in grid.volmesh.faces():

        # Get the normal of the half-face (hint: face_normal() of volmesh)
        hf_normal = grid.volmesh.face_normal(hf)
        hf_vector = Vector(hf_normal[0], hf_normal[1], hf_normal[2])

        # if it's parallel to the unit Z axis, we will add a slab
        dot_product_z_axis = hf_vector.dot(Vector.Zaxis())
        if abs(dot_product_z_axis) == 1:
            
            # To add a slab:
            # 1. find the centroid of the half-face (hint: halfface_centroid() of volmesh)
            centroid = grid.volmesh.halfface_centroid(hf)
            # 2. Take the first two edges of the half-face (hint: halfface_halfedges() of volmesh)
            hf_edges = grid.volmesh.halfface_halfedges(hf)
            
            # 3. And calculate width and depth of the slab from their lengths (hint: edge_length() of volmesh)
            width = grid.volmesh.edge_length(hf_edges[0])
            depth = grid.volmesh.edge_length(hf_edges[1])

            # 4. Create a box with those values + the slab_height attribute of the grid 
            #    (hint: use Box constructor taking width, height and depth parameters)
            box = Box.from_width_height_depth(width, grid.slab_height, depth)

            # 5. The box was created at (0,0,0), move it to the correct point
            box.frame.point = centroid
            box.frame.point.z += grid.slab_height / 2
            
            # 6. Create an instance of the slab class you created above
            slab = Slab(box)

            # 7. Append it to the grid.slabs attribute list
            grid.slabs.append(slab)

            # END OF MAIN TASK

            # START OF CHALLENGE 01

            # Detect if there's a cell opposite to the half-face we're in (hint: halfface_opposite_cell() of volmesh)
            opposite_cell = grid.volmesh.halfface_opposite_cell(hf)

            # If there's an opposite cell, it's a floor_slab function
            # if not, and the dot product to the z axis is positive, it's a roof (ie. there are no cells above it).
            # if not, and the dot product to the z axis is negative, it's a bottom_slab (ie. there are no cells below it).
            if opposite_cell:
                slab.function = "floor_slab"
            elif dot_product_z_axis > 0:
                slab.function = "roof"
            elif dot_product_z_axis < 0:
                slab.function = "bottom_slab"
            # END OF CHALLENGE 01


# Call the method to gnerate slabs
generate_slabs(grid)

# And assign the grid.slabs attribute to the correct output attribute
slabs = grid.slabs
# ---------- end slabs ----------

# ----
# Create structure
cells = GhPythonScript(grid=grid)  # -> cells
# ---------- cells: Python ----------
# This component does a custom conversion of the volmesh cell
# into Box BREPs. The current version of compas would generate
# meshes for each box, so for better visualization, we use this
# alternative option to create breps.

import Rhino.Geometry as rg

cells = []

for cell in grid.volmesh.cells():
    vertices = grid.volmesh.cell_vertices(cell)
    vertices_coords = []
    for vertex in vertices:
        vertices_coords.append(grid.volmesh.vertex_coordinates(vertex))

    start = min(vertices_coords)
    end = max(vertices_coords)

    start_point = rg.Point3d(start[0], start[1], start[2])
    end_point = rg.Point3d(end[0], end[1], end[2])

    cell = rg.Box(rg.BoundingBox(start_point, end_point))
    cells.append(cell)
# ---------- end cells ----------
columns = GhPythonScript(grid=grid)  # -> columns
# ---------- columns: Python ----------
# We use this direct conversion instead of the component
# because we want the Box BREP instead of the meshes
from compas_rhino.conversions import box_to_rhino
from compas.geometry import Box
from compas.geometry import Frame
from compas.geometry import Vector


def generate_columns(grid):
    # First reset the list of columns
    grid.columns = []

    # Now generate columns
    for uv in grid.volmesh.edges():

        # If the edge vector is parallel to unit vector Z...
        edge_direction = grid.volmesh.edge_direction(uv)
        edge_vector = Vector(edge_direction[0], edge_direction[1], edge_direction[2])
        if edge_vector.dot(Vector.Zaxis()) in (1, -1):

            # ...we add a column
            edge_point = grid.volmesh.edge_point(uv)
            edge_length = grid.volmesh.edge_length(uv)

            frame = Frame(edge_point, Vector.Xaxis(), Vector.Yaxis())
            column = Box(frame, grid.column_width_x, grid.column_depth_y, edge_length)
            grid.columns.append(column)

# Call the method to generate columns
generate_columns(grid)

# And generate all the geometry (BREPs) for each
columns = []

for column in grid.columns:
    column = box_to_rhino(column)
    columns.append(column)
# ---------- end columns ----------
main_beams = GhPythonScript(grid=grid)  # -> mainbeams
# ---------- main_beams: Python ----------
# We use this direct conversion instead of the component
# because we want the Box BREP instead of the meshes
from compas_rhino.conversions import box_to_rhino
from compas.geometry import Box
from compas.geometry import Frame
from compas.geometry import Line
from compas.geometry import Vector

def generate_main_beams(grid):
    # Reset list of main beams
    grid.main_beams = []
    
    # Generate main beams
    for uv in grid.volmesh.edges():

        # If the edge vector is perpendicular to unit vector Z...
        edge_direction = grid.volmesh.edge_direction(uv)
        edge_vector = Vector(edge_direction[0], edge_direction[1], edge_direction[2])
        if edge_vector.dot(Vector.Zaxis()) == 0:

            # ... we add a main bean 
            start, end = grid.volmesh.edge_coordinates(uv)
            line = Line(start, end)
            
            # Shorten the beam to fit the columns
            if edge_vector.dot(Vector.Xaxis()) in (1, -1):
                shift_value = grid.column_width_x
            else:
                shift_value = grid.column_depth_y

            # Create the box in the origin of world XY frame
            mainbeam = Box.from_width_height_depth(grid.main_beam_width, grid.main_beam_height, line.length - shift_value)
            
            # Create a frame where the beam has to be placed
            frame = Frame(line.midpoint, edge_vector.cross(Vector.Zaxis()), edge_vector)
            frame.point.z -= grid.main_beam_height / 2
    
            # Move box to newly created frame
            mainbeam.frame = frame

            grid.main_beams.append(mainbeam)

# Call the method to gnerate main beams
generate_main_beams(grid)

# And generate all the geometry (BREPs) for each
mainbeams = []

for mainbeam in grid.main_beams:
    b = box_to_rhino(mainbeam)
    mainbeams.append(b)
# ---------- end main_beams ----------
slabs_2 = GhPythonScript(slabs=slabs)  # -> floor_slabs, roofs, bottom_slabs; inputs slabs: list
# ---------- slabs_2: Python ----------
# Notes: this code will iterate over all slabs
# and separate them into different lists based on their function
from compas_rhino.conversions import box_to_rhino

roofs = []
floor_slabs = []
bottom_slabs = []

for slab in slabs:
    b = box_to_rhino(slab.shape)
    if slab.function == "roof":
        roofs.append(b)
    elif slab.function == "bottom_slab":
        bottom_slabs.append(b)
    else:
        floor_slabs.append(b)
# ---------- end slabs_2 ----------

# ---- group: Cells
# Visualization
colour_swatch = ColourSwatch(SwatchColor=RGBA(41, 115, 111, 124))
custom_preview = CustomPreview(Geometry=cells, Material=colour_swatch)

# ---- group: Columns
custom_preview_2 = CustomPreview(Geometry=columns, Material=ColourSwatch(SwatchColor=RGBA(115, 41, 41, 124)))

# ---- group: Main beams
custom_preview_3 = CustomPreview(Geometry=main_beams, Material=ColourSwatch(SwatchColor=RGBA(252, 129, 35, 156)))

# ----
custom_preview_4 = CustomPreview(Geometry=slabs_2.floor_slabs, Material=ColourSwatch(SwatchColor=RGBA(181, 178, 147, 135)))

custom_preview_5 = CustomPreview(Geometry=slabs_2.roofs, Material=ColourSwatch(SwatchColor=RGBA(235, 208, 188, 173)))

custom_preview_6 = CustomPreview(Geometry=slabs_2.bottom_slabs, Material=ColourSwatch(SwatchColor=RGBA(143, 159, 176, 131)))

# ----
# Analysis
# Challenge 02
volume = GhPythonScript(grid=grid)  # -> out
# ---------- volume: Python ----------
"""
## Challenge 02

Goal: Calculate and print total volume of slabs, and the number (amount) of each element type (slabs, columns and main beams).

The methods to get the numbers of columns and mainbeams already exist on the BuildingGrid class so we can print them out directly.
A new method number_of_slabs() needs to be added to the BuildingGrid class.

A new method to calculate the volume of each slab needs to be added to the Slab class.

#### Details

The algorithm that we need to implement, as well as hints to functions you might need,
is in code comments, as a step-by-step guide.

"""

# 1. Print the number of columns using the method number_of_columns() of the grid
print("Number of columns: {}".format(grid.number_of_columns()))
# 2. Print the number of main beams using the method number_of_mainbeams() of the grid
print("Number of main beams: {}".format(grid.number_of_mainbeams()))
# 3. Add a method number_of_slabs() to the BuildingGrid class (follow the template of number_of_columns() & number_of_mainbeams() already present) 
#    and print its value here 
print("Number of slabs: {}".format(grid.number_of_slabs()))

# 4. Add a method calculate_volume() to your Slab class (you have to do this in the component where you wrote the Slab class!)
#   This method will return the volume of the slab
#   (hint: the box already has a volume attribute so the calculate_volume() can simply return that)

# 5. Iterate over the slabs of the grid and accumulate (sum) the volumes of each slab in a variable
total_volume = 0
for slab in grid.slabs:
    total_volume += slab.calculate_volume()

# 6. Print out the total volume (hint: round up the number and format the string nicely)
print("Total slab volume: {}".format(round(total_volume, 2)))
# ---------- end volume ----------
panel = Panel(volume)
