# Grasshopper definition 00_anatomy_of_code.gh (Grasshopper 1.0.7)

# ----
# Anatomy of code
python = GhPythonScript()  # -> out, a
# ---------- python: Python ----------
# Anatomy of Code
# In a line of code, everything after the hash is a comment

42                                  # value: data can be of many different types. integers, floats, strings, bools, list, etc
10 * 30                             # expression: this expressions produces the result '300', but we don't do anything with it
answer = 42                         # variable: 'answer' is a variable, it is a container for data, in this case '42'

answer * 10                         # expressions can also include a variable

result = answer * 10                # statement: for example, assigning the value of an expression to a new variable, 

if result > 20:                     # conditional statement: another type of statement, this one checks for a condition
  print("Look at you!")             # .. and this line (and all indented at the same level) will only be executed if condition is true

for i in range(5):                  # control flow statement: another type of statement, this one allows repeating statements multiple times
  print(i)                          # .. all indented lines at the same level will be repeated as many times as defined in the 'for' loop


result = 0                          # algorithm: a sequence of instructions, typically used to get the solution to a given problem
for i in range(100):
    result = result + i * 2         # this can also be written as:  result += i * 2
    if result <= 42:
        print(result)
    elif result > 42:
        break


def abs(value):                     # function (aka definition)
    if value < 0:                   # .. wraps an algorithm in a 
        return value * -1           # .. reusable building block
    else:
        return value

print("The result of calling abs() with -42 is:")
print(abs(-42))
# ---------- end python ----------
