# Grasshopper definition 01_arithmetic_operations.gh (Grasshopper 1.0.7)

# ----
# Addition
# Input from panel, type hint: int
# type hint: int
panel = Panel("5")
python = GhPythonScript(x=panel, y="10")  # -> out, result; inputs x: Int32, y: Int32
# ---------- python: Python ----------
result = x + y
# ---------- end python ----------
panel_2 = Panel(python.result)

# ----
# Input from panel, no type hint -> produces error
# without type hint
panel_3 = Panel("5")
python_2 = GhPythonScript(x=panel_3, y="10")  # -> out, result; same code as python
panel_4 = Panel(python_2.result)

# ----
# Arithmetic Operations
# Grasshopper
# Addition
# Addition
panel_5 = Panel("5")
# GHPython
panel_6 = Panel("10")
addition = Addition(A=panel_5, B=panel_6)
panel_7 = Panel(addition)

# ----
# Evaluate
panel_8 = Panel("5")
eval = Evaluate(F="x+y", x=panel_8, y="10")
panel_9 = Panel(eval)

# ----
# Input from panel, type: int defined in code
# without type hint
# type defined in code
panel_10 = Panel("5")
python_3 = GhPythonScript(x=panel_10, y="10")  # -> out, result
# ---------- python_3: Python ----------
result = int(x) + int(y)
# ---------- end python_3 ----------
panel_11 = Panel(python_3.result)

# ----
# Input from number slider
# without type hint
# but with number slider
number_slider = Slider(5, range=0..10)
python_4 = GhPythonScript(x=number_slider, y=Slider(10, range=0..10))  # -> out, result; same code as python
panel_12 = Panel(python_4.result)

# ----
# Expression
panel_13 = Panel("5")
expression = Expression(x=panel_13, y="10", Expression="x+y")
panel_14 = Panel(expression)

# ----
# Mass Addition
panel_15 = Panel("""5
3
24
6
8
9""")
ma = MassAddition(Input=panel_15)  # -> Result, PartialResults
panel_16 = Panel(ma.Result)

# ----
# Mass Addition, built-in function
# type hint: int
# List Access
panel_17 = Panel("""5
3
24
6
8
9""")
python_5 = GhPythonScript(values=panel_17)  # -> out, result; inputs values: list of Int32
# ---------- python_5: Python ----------
result = sum(values)
# ---------- end python_5 ----------
panel_18 = Panel(python_5.result)

# ----
# Mass Addition, using a `for` loop
# type hint: int
# List Access
panel_19 = Panel("""5
3
24
6
8
9""")
python_6 = GhPythonScript(values=panel_19)  # -> out, result; inputs values: list of Int32
# ---------- python_6: Python ----------
result = 0

for value in values:
    result += value
# ---------- end python_6 ----------
panel_20 = Panel(python_6.result)

mod = Modulus(A=Slider(9, range=0..10), B="3")

# ----
# type hint: int
number_slider_2 = Slider(9, range=0..10)

# ----
# Modulo
python_7 = GhPythonScript(x=number_slider_2, y="3")  # -> out, result; inputs y: Int32
# ---------- python_7: Python ----------
import math

result = x % y
# ---------- end python_7 ----------
panel_21 = Panel(python_7.result)

# ----
# Modulo
panel_22 = Panel(mod)

# ----
# Square Root (import math library)
# type hint: int
panel_23 = Panel("5")
python_8 = GhPythonScript(x=panel_23)  # -> out, result
# ---------- python_8: Python ----------
import math

result = math.sqrt(x)
# ---------- end python_8 ----------
panel_24 = Panel(python_8.result)

# ----
# Square Root
panel_25 = Panel("5")
sqrt = SquareRoot(Value=panel_25)
panel_26 = Panel(sqrt)

# ----
# Pi  (import math library)
python_9 = GhPythonScript()  # -> out, result
# ---------- python_9: Python ----------
import math

result = math.pi
print(result)
# ---------- end python_9 ----------
panel_27 = Panel(python_9.out)

# ----
# Pi
panel_28 = Panel("1")
pi = Pi(Factor=panel_28)
panel_29 = Panel(pi)

panel_30 = Panel(python_9.result)

series = Series(Start=0, Step=1, Count=10)
python_10 = GhPythonScript(x=series)  # -> out, y
# ---------- python_10: Python ----------
y = x ** 2
# ---------- end python_10 ----------
pt = ConstructPoint(XCoordinate=series, YCoordinate=python_10.y, ZCoordinate=0)

dom = ConstructDomain(DomainStart="-10", DomainEnd="10")
range = Range(Domain=dom, Steps=Slider(10, range=0..10))
python_11 = GhPythonScript(x=range)  # -> out, y; inputs x: Int32; same code as python_10
pt_2 = ConstructPoint(XCoordinate=range, YCoordinate=python_11.y, ZCoordinate=0)

# ----
# Polynomials Square
series_2 = Series(Start=0, Step=1, Count=10)
power = Power(A=series_2, B="2")
pt_3 = ConstructPoint(XCoordinate=series_2, YCoordinate=power, ZCoordinate=0)
panel_31 = Panel(pt_3)

# ----
# Polynomials Square
panel_32 = Panel(pt)

# ----
# Polynomials Square
panel_33 = Panel(pt_2)
