# Grasshopper definition 02-building-grid-tutorial-01-solution.gh (Grasshopper 1.0.7)

# ----
# Applying classes to create buildings
# Filters selection
modulo_filter = GhPythonScript()  # -> mfilter
# ---------- modulo_filter: Python ----------
# Sample filter
class ModuleBasedFilter(object):
    def is_included(self, x, y, z):
        if (x + y) % 2 == 0:
            return True

        return False

mfilter = ModuleBasedFilter()
# ---------- end modulo_filter ----------
random_filter = GhPythonScript()  # -> rfilter
# ---------- random_filter: Python ----------
# Sample filter
from random import choice

class RandomFilter(object):
    def is_included(self, x, y, z):
        return choice([True, False])

rfilter = RandomFilter()
# ---------- end random_filter ----------
linear_filter = GhPythonScript()  # -> lfilter
# ---------- linear_filter: Python ----------
# Sample filter
class LinearFilter(object):
    def __init__(self, coefficient=1, vertical_shift_x=0, vertical_shift_y=0, horizontal_shift_x=0, horizontal_shift_y=0):
        super(LinearFilter, self).__init__()
        self.coefficient = coefficient
        self.vertical_shift_x = vertical_shift_x
        self.vertical_shift_y = vertical_shift_y
        self.horizontal_shift_x = horizontal_shift_x
        self.horizontal_shift_y = horizontal_shift_y

    def is_included(self, x, y, z):
        z_range_x = (self.coefficient * x + self.vertical_shift_x) + self.horizontal_shift_x
        z_range_y = (self.coefficient * y + self.vertical_shift_y) + self.horizontal_shift_y
        return not z_range_x < z > z_range_y

lfilter = LinearFilter(coefficient= 3, vertical_shift_x= -3, vertical_shift_y=-3, horizontal_shift_x=0, horizontal_shift_y=0)
# ---------- end linear_filter ----------
value_list = ValueList({"Modulo filter": 0, "Random filter": 1, "Linear filter": 2}, selected="Linear filter")
stream_filter = StreamFilter(Gate=value_list, Stream0=modulo_filter, Stream1=random_filter, Stream2=linear_filter)

# ---- group: Grid size
number_slider = Slider(9, range=0..20)
number_slider_2 = Slider(9, range=0..20)
number_slider_3 = Slider(18, range=0..20)

# ---- group: Cell sizes
number_slider_4 = Slider(5, range=0..20)
number_slider_5 = Slider(4.5, range=0..20)
number_slider_6 = Slider(3.5, range=0..20)

# ---- group: Options
main_beam_width = Slider(0.35, range=0.1..0.9)
main_beam_height = Slider(0.4, range=0.1..0.9)
column_width_x = Slider(0.35, range=0.1..0.9)
column_depth_y = Slider(0.45, range=0.1..0.9)

# ----
# Create grid based on volumetric mesh
python = GhPythonScript()  # -> from_meshgrid
# ---------- python: Python ----------
from itertools import product
from compas.datastructures import VolMesh
from compas.utilities import linspace

def from_meshgrid(selected_filter, dx, dy, dz, nx, ny, nz):
    vertices = [
        [x*nx, y*ny, z*nz]
        for z, x, y in product(
            linspace(0, dz, nz + 1),
            linspace(0, dx, nx + 1),
            linspace(0, dy, ny + 1),
        )
    ]

    cells = []
    for k, i, j in product(range(nz), range(nx), range(ny)):
        if not selected_filter.is_included(j, i, k):
            continue
        a = k * ((nx + 1) * (ny + 1)) + i * (ny + 1) + j
        b = k * ((nx + 1) * (ny + 1)) + (i + 1) * (ny + 1) + j
        c = k * ((nx + 1) * (ny + 1)) + (i + 1) * (ny + 1) + j + 1
        d = k * ((nx + 1) * (ny + 1)) + i * (ny + 1) + j + 1
        aa = (k + 1) * ((nx + 1) * (ny + 1)) + i * (ny + 1) + j
        bb = (k + 1) * ((nx + 1) * (ny + 1)) + (i + 1) * (ny + 1) + j
        cc = (k + 1) * ((nx + 1) * (ny + 1)) + (i + 1) * (ny + 1) + j + 1
        dd = (k + 1) * ((nx + 1) * (ny + 1)) + i * (ny + 1) + j + 1
        bottom = [d, c, b, a]
        front = [a, b, bb, aa]
        right = [b, c, cc, bb]
        left = [a, aa, dd, d]
        back = [c, d, dd, cc]
        top = [aa, bb, cc, dd]
        cells.append([bottom, front, left, back, right, top])

    return VolMesh.from_vertices_and_cells(vertices, cells)
# ---------- end python ----------
filter = Data(stream_filter)
grid = GhPythonScript(
    from_meshgrid=python,
    nx=number_slider,
    ny=number_slider_2,
    nz=number_slider_3,
    selected_filter=filter,
    xsize=number_slider_4,
    ysize=number_slider_5,
    zsize=number_slider_6,
    main_beam_width=main_beam_width,
    main_beam_height=main_beam_height,
    column_width_x=column_width_x,
    column_depth_y=column_depth_y)  # -> out, grid; inputs nx: Int32, ny: Int32, nz: Int32
# ---------- grid: Python ----------
from compas.geometry import Box
from compas.geometry import Frame
from compas.geometry import Line
from compas.geometry import Vector

# Instead of a simple list of points
# We will now create a class that contains both data (attributes)
# of our grid and also its behavior (methods)
class BuildingGrid(object):
    def __init__(self, xsize, ysize, zsize, nx, ny, nz, selected_filter, main_beam_width, main_beam_height, column_width_x, column_depth_y):
        self.volmesh = from_meshgrid(selected_filter, xsize, ysize, zsize, nx, ny, nz)
        self.volmesh.cull_vertices()
        self.columns = []
        self.main_beams = []

        self.main_beam_width = main_beam_width
        self.main_beam_height = main_beam_height
        self.column_width_x = column_width_x
        self.column_depth_y = column_depth_y

    def generate_columns(self):
        # First reset the list of columns
        self.columns = []

        # Now generate columns
        for uv in self.volmesh.edges():
            edge_direction = self.volmesh.edge_direction(uv)
            edge_vector = Vector(*edge_direction)
            if edge_vector.dot(Vector.Zaxis()) in (1, -1):
                edge_point = self.volmesh.edge_point(uv)
                edge_length = self.volmesh.edge_length(uv)

                frame = Frame(edge_point, Vector.Xaxis(), Vector.Yaxis())
                column = Box(frame, self.column_width_x, self.column_depth_y, edge_length)
                self.columns.append(column)

    def generate_main_beams(self):
        # Reset list of main beams
        self.main_beams = []
        
        # Generate main beams
        for uv in self.volmesh.edges():
            edge_direction = self.volmesh.edge_direction(uv)
            edge_vector = Vector(*edge_direction)
            if edge_vector.dot(Vector.Zaxis()) == 0:

                start, end = self.volmesh.edge_coordinates(uv)
                line = Line(start, end)
                
                # Shorten the beam to fit the columns
                if edge_vector.dot(Vector.Xaxis()) in (1, -1):
                    shift_value = self.column_width_x
                else:
                    shift_value = self.column_depth_y
                
                # Create the box in the origin of world XY frame
                mainbeam = Box.from_width_height_depth(self.main_beam_width, self.main_beam_height, line.length - shift_value)
                frame = Frame(line.midpoint, edge_vector.cross(Vector.Zaxis()), edge_vector)
                frame.point.z -= self.main_beam_height / 2
        
                # Move box to correct frame
                mainbeam.frame = frame

                self.main_beams.append(mainbeam)

    def number_of_columns(self):
        return len(self.columns)

    def number_of_mainbeams(self):
        return len(self.mainbeams)

grid = BuildingGrid(xsize, ysize, zsize, nx, ny, nz, selected_filter, main_beam_width, main_beam_height, column_width_x, column_depth_y)
# ---------- end grid ----------

# ----
# Create structure
cells = GhPythonScript(grid=grid.grid)  # -> cells
# ---------- cells: Python ----------
# This component does a custom conversion of the volmesh cell
# into Box BREPs. The current version of compas would generate
# meshes for each box, so for better visualization, we use this
# alternative option to create breps.

import Rhino.Geometry as rg

cells = []

for cell in grid.volmesh.cells():
    vertices = grid.volmesh.cell_vertices(cell)
    vertices_coords = []
    for vertex in vertices:
        vertices_coords.append(grid.volmesh.vertex_coordinates(vertex))

    start = min(vertices_coords)
    end = max(vertices_coords)

    start_point = rg.Point3d(start[0], start[1], start[2])
    end_point = rg.Point3d(end[0], end[1], end[2])

    cell = rg.Box(rg.BoundingBox(start_point, end_point))
    cells.append(cell)
# ---------- end cells ----------
columns = GhPythonScript(grid=grid.grid)  # -> columns
# ---------- columns: Python ----------
# We use this direct conversion instead of the component
# because we want the Box BREP instead of the meshes
from compas_rhino.conversions import box_to_rhino

grid.generate_columns()

columns = []

for column in grid.columns:
    column = box_to_rhino(column)
    columns.append(column)
# ---------- end columns ----------
main_beams = GhPythonScript(grid=grid.grid)  # -> mainbeams
# ---------- main_beams: Python ----------
# We use this direct conversion instead of the component
# because we want the Box BREP instead of the meshes
from compas_rhino.conversions import box_to_rhino

grid.generate_main_beams()

mainbeams = []

for mainbeam in grid.main_beams:
    b = box_to_rhino(mainbeam)
    mainbeams.append(b)
# ---------- end main_beams ----------

# ---- group: Cells
custom_preview = CustomPreview(Geometry=cells, Material=ColourSwatch(SwatchColor=RGBA(41, 115, 111, 124)))

# ---- group: Columns
custom_preview_2 = CustomPreview(Geometry=columns, Material=ColourSwatch(SwatchColor=RGBA(115, 41, 41, 124)))

# ---- group: Main beams
custom_preview_3 = CustomPreview(Geometry=main_beams, Material=ColourSwatch(SwatchColor=RGBA(252, 129, 35, 156)))

# ---- group: Explore cells and neighbors
# Visualization
number_slider_7 = Slider(0, range=0..1161)
cells_2 = GhPythonScript(grid=grid.grid, i=number_slider_7)  # -> cell, neighbors
# ---------- cells_2: Python ----------
print "Found {} cells".format(grid.volmesh.number_of_cells())

cell = grid.volmesh.cell_to_mesh(i)
neighbors = []

for nbr in grid.volmesh.cell_neighbors(i):
    neighbors.append(grid.volmesh.cell_to_mesh(nbr))
# ---------- end cells_2 ----------
draw = Draw(cg=cells_2.cell)  # -> rg
#   port cg: The COMPAS geometry or datastructure to be drawn.
#   port rg: The Rhino geometry object.
# ---------- draw: Python ----------
"""
Draws COMPAS geometry in Grasshopper.
"""
from ghpythonlib.componentbase import executingcomponent as component

from compas.artists import Artist


class CompasToRhinoGeometry(component):
    def RunScript(self, cg):
        if not cg:
            return None

        return Artist(cg).draw()
# ---------- end draw ----------
draw_2 = Draw(cg=cells_2.neighbors)  # -> rg; same code as draw
